# Grasshopper definition test.ghx (Grasshopper 1.0.8)

number_slider = Slider(7, range=0..100)
multiplication = Multiplication(A=number_slider, B=Slider(4, range=0..10))
cir = Circle(Plane=PlaneXY(0, 0, 0), Radius=number_slider)
Z = UnitZ(Factor=multiplication)
move = Move(Geometry=cir, Motion=Z)  # -> Geometry, Transform
area = Area(Geometry=move.Geometry)  # -> Area, Centroid
scale = Scale(Geometry=move.Geometry, Center=area.Centroid, Factor=0.5)  # -> Geometry, Transform
